# Grasshopper definition 0225 demo parse.gh (Grasshopper 1.0.7)

file_path = FilePath("C:\Users\liche\PycharmProjects\WinterGardenEnergy\results\164578933997.02618\temperature.txt")
file_path_2 = FilePath("C:\Users\liche\PycharmProjects\WinterGardenEnergy\results\164579041956.97922\temperature.txt")
read_file = ReadFile(File=file_path, PerLineParse=True)
file_path_3 = FilePath("C:\Users\liche\PycharmProjects\WinterGardenEnergy\results\164579094738.44788\temperature.txt")
read_file_2 = ReadFile(File=file_path_2, PerLineParse=True)
read_file_3 = ReadFile(File=file_path_3, PerLineParse=True)
text_split = TextSplit(Text=read_file, Separators=",")
text_split_2 = TextSplit(Text=read_file_2, Separators=",")
text_split_3 = TextSplit(Text=read_file_3, Separators=",")
list_item = ListItem(List=text_split, Index=0, Wrap=True)  # -> flatten(Item), flatten(Item1), flatten(Item2)
list_item_2 = ListItem(List=text_split_2, Index=0, Wrap=True)  # -> flatten(Item), flatten(Item1), flatten(Item2)
list_item_3 = ListItem(List=text_split_3, Index=0, Wrap=True)  # -> flatten(Item), flatten(Item1), flatten(Item2)
series = Series(Start=0, Step=0.05, Count=8760)
series_2 = Series(Start=0, Step=0.05, Count=8760)
series_3 = Series(Start=0, Step=0.05, Count=8760)
vector_xyz = VectorXYZ(XComponent=series, YComponent=list_item.Item2, ZComponent=0)  # -> Vector, Length
vector_xyz_2 = VectorXYZ(XComponent=series, YComponent=list_item.Item1, ZComponent=0)  # -> Vector, Length
vector_xyz_3 = VectorXYZ(XComponent=series, YComponent=list_item.Item, ZComponent=0)  # -> Vector, Length
vector_xyz_4 = VectorXYZ(XComponent=series_2, YComponent=list_item_2.Item2, ZComponent=0)  # -> Vector, Length
vector_xyz_5 = VectorXYZ(XComponent=series_2, YComponent=list_item_2.Item1, ZComponent=0)  # -> Vector, Length
vector_xyz_6 = VectorXYZ(XComponent=series_2, YComponent=list_item_2.Item, ZComponent=0)  # -> Vector, Length
vector_xyz_7 = VectorXYZ(XComponent=series_3, YComponent=list_item_3.Item2, ZComponent=0)  # -> Vector, Length
vector_xyz_8 = VectorXYZ(XComponent=series_3, YComponent=list_item_3.Item1, ZComponent=0)  # -> Vector, Length
vector_xyz_9 = VectorXYZ(XComponent=series_3, YComponent=list_item_3.Item, ZComponent=0)  # -> Vector, Length
polyline = PolyLine(Vertices=vector_xyz.Vector, Closed=False)
polyline_2 = PolyLine(Vertices=vector_xyz_2.Vector, Closed=False)
polyline_3 = PolyLine(Vertices=vector_xyz_3.Vector, Closed=False)
polyline_4 = PolyLine(Vertices=vector_xyz_4.Vector, Closed=False)
polyline_5 = PolyLine(Vertices=vector_xyz_5.Vector, Closed=False)
polyline_6 = PolyLine(Vertices=vector_xyz_6.Vector, Closed=False)
polyline_7 = PolyLine(Vertices=vector_xyz_7.Vector, Closed=False)
polyline_8 = PolyLine(Vertices=vector_xyz_8.Vector, Closed=False)
polyline_9 = PolyLine(Vertices=vector_xyz_9.Vector, Closed=False)
